# Grasshopper definition shape_action_graph-all_steps(BIM).gh (Grasshopper 0.9.76)
# plug-ins: Karamba, Python Interpreter, gHowl, Grasshopper-ARCHICAD Live Connection 2.0

fixed_shapes = Curve(reparameterize([<curve referenced from the Rhino model> x2]))
columns = Curve(reparameterize([<curve referenced from the Rhino model> x6]))
perimeters = Curve(reparameterize([<curve referenced from the Rhino model> x70]))
start_node = Point(Point(19569.52631, -58881.2317, 0))
shafts = Curve(reparameterize([<curve referenced from the Rhino model> x2]))
connections = Curve([<curve referenced from the Rhino model> x318])
glazing = Curve(reparameterize([<curve referenced from the Rhino model> x172]))
shapes = Curve(reparameterize([<curve referenced from the Rhino model> x151]))
doors = Curve(reparameterize([<curve referenced from the Rhino model> x165]))
names = Guid([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])
codes = Guid([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])
example_02 = Entwine(
    Branch00=shafts,
    Branch01=columns,
    Branch02=shapes,
    Branch03=perimeters,
    Branch04=fixed_shapes,
    Branch05=doors,
    Branch06=glazing,
    Branch07=connections,
    Branch08=names,
    Branch09=start_node,
    Branch010=codes,
    FlattenInputs=True)  # -> simplify(Result)

fixed_shapes_2 = Curve()
columns_2 = Curve()
perimeters_2 = Curve(reparameterize([<curve referenced from the Rhino model> x12]))
start_node_2 = Point(<point referenced from the Rhino model>)
connections_2 = Curve([<curve referenced from the Rhino model> x26])
shafts_2 = Curve()
shapes_2 = Curve(reparameterize([<curve referenced from the Rhino model> x27]))
glazing_2 = Curve()
doors_2 = Curve()
names_2 = Guid([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])
codes_2 = Guid([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])
example_00 = Entwine(
    Branch00=shafts_2,
    Branch01=columns_2,
    Branch02=shapes_2,
    Branch03=perimeters_2,
    Branch04=fixed_shapes_2,
    Branch05=doors_2,
    Branch06=glazing_2,
    Branch07=connections_2,
    Branch08=names_2,
    Branch09=start_node_2,
    Branch010=codes_2,
    FlattenInputs=True)  # -> simplify(Result)

fixed_shapes_3 = Curve()
columns_3 = Curve()
perimeters_3 = Curve(reparameterize([<curve referenced from the Rhino model> x20]))
start_node_3 = Point(Point(17133.30719, -37276.25337, 0))
shafts_3 = Curve()
connections_3 = Curve([<curve referenced from the Rhino model> x48])
glazing_3 = Curve()
shapes_3 = Curve(reparameterize([<curve referenced from the Rhino model> x49]))
doors_3 = Curve()
names_3 = Guid([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])
codes_3 = Guid([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])
example_01 = Entwine(
    Branch00=shafts_3,
    Branch01=columns_3,
    Branch02=shapes_3,
    Branch03=perimeters_3,
    Branch04=fixed_shapes_3,
    Branch05=doors_3,
    Branch06=glazing_3,
    Branch07=connections_3,
    Branch08=names_3,
    Branch09=start_node_3,
    Branch010=codes_3,
    FlattenInputs=True)  # -> simplify(Result)

# ----
# Authors: Pedro Veloso (CMU), Gabriela Celani (UNICAMP) and Rodrigo Scheeren (USP)
# 
# Prototype of Shape Action Graph.
# 
# Developed for paper: From the generation of layouts to the production of construction documents: an
# application in the customization of apartment plans
# 
# 06/25/2018
list = ValueList({"Example 00": 0, "Example 01": 1, "Example 02": 2}, selected="Example 02")
grammar_i = Integer(list)

# ----
# step 0: filter apt type (here is manually, but can do via UDP)
# Use datatree to group and filter the different apartment types. Due to the consistentcy, it has to reset the paths to 0 before the next step
filter = StreamFilter(Gate=grammar_i, Stream0=example_00, Stream1=example_01, Stream2=example_02)
bang = ExplodeTree(Data=filter)  # -> Branch0, Branch1, Branch2, Branch3, Branch4, Branch5, Branch6, Branch7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
path_mapper = PathMapper(bang.Branch4, source="{A}", target="{0}")
path_mapper_2 = PathMapper(bang.Branch7, source="{A}", target="{0}")
path_mapper_3 = PathMapper(bang.Branch3, source="{A}", target="{0}")
path_mapper_4 = PathMapper(bang.Branch0, source="{A}", target="{0}")
path_mapper_5 = PathMapper(bang.Branch2, source="{A}", target="{0}")
path_mapper_6 = PathMapper(bang.Branch10, source="{A}", target="{0}")
path_mapper_7 = PathMapper(bang.Branch1, source="{A}", target="{0}")
path_mapper_8 = PathMapper(bang.Branch5, source="{A}", target="{0}")
path_mapper_9 = PathMapper(bang.Branch8, source="{A}", target="{0}")
path_mapper_10 = PathMapper(bang.Branch9, source="{A}", target="{0}")

path_mapper_11 = PathMapper(bang.Branch6, source="{A}", target="{0}")

# ---- group: raw input
fixed_shapes_4 = Curve(reparameterize(path_mapper))
start_node_4 = Point(path_mapper_10)
connections_4 = Curve(path_mapper_2)
shapes_4 = Curve(reparameterize(path_mapper_5))
perimeters_4 = Curve(reparameterize(path_mapper_3))
columns_4 = Curve(reparameterize(path_mapper_7))
shafts_4 = Curve(reparameterize(path_mapper_4))
doors_4 = Curve(reparameterize(path_mapper_8))
glazing_4 = Curve(reparameterize(path_mapper_11))
codes_4 = Guid(path_mapper_6)
names_4 = Guid(path_mapper_9)

# ----
panel = Panel("step 1: treat input")
treatrhinoinput = TreatRhinoInput(
    shafts=shafts_4,
    columns=columns_4,
    shapes=shapes_4,
    perimeters=perimeters_4,
    fixed_shapes=fixed_shapes_4,
    doors=doors_4,
    final_glazing=glazing_4,
    final_connections=connections_4,
    names=names_4,
    start_node=start_node_4,
    codes=codes_4)  # -> origin_pts_2, perimter_bound_rects_2, off_perimeter_bound_rects_2, final_shafts_2, final_columns_2, final_perimeters_2, final_glazing_3, final_all_shapes_2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

# ---- group: treated input
off_perimeter_bound_rects = Curve(treatrhinoinput.off_perimeter_bound_rects_2)
final_start_node = Point(treatrhinoinput.start_node_3)
final_perimeters = Curve(treatrhinoinput.final_perimeters_2)
perimeter_bound_rects = Curve(treatrhinoinput.perimter_bound_rects_2)
final_connections = Curve(treatrhinoinput.final_connections_3)
final_columns = Curve(treatrhinoinput.final_columns_2)
final_codes_pt = Text(treatrhinoinput.final_codes_pt_2)
final_fixed_shapes = Curve(treatrhinoinput.final_fixed_shapes_2)
final_names = Text(treatrhinoinput.final_names_2)
final_names_pt = Point(treatrhinoinput.final_names_pt_2)
final_shafts = Curve(treatrhinoinput.final_shafts_2)
final_codes = Text(treatrhinoinput.final_codes_2)
final_glazing = Curve(treatrhinoinput.final_glazing_3)
final_all_shapes = Curve(treatrhinoinput.final_all_shapes_2)
final_doors = Curve(treatrhinoinput.doors_3)
origin_pts = Point(treatrhinoinput.origin_pts_2)

# ----
panel_2 = Panel("step 2: create graph")
create_graph = CreateGraph(connections=final_connections, fixed_shapes=final_fixed_shapes, shapes=final_all_shapes)  # -> dgv, idgv, G_2, gv_2
G = Integer(create_graph.G_2)
idg = Number(create_graph.idgv)
dg = Number(create_graph.dgv)
gv = Point(create_graph.gv_2)

# ----
# step 3: generate maps between index systems
mapindices = MapIndices(
    codes_origins=final_codes_pt,
    names_origins=final_names_pt,
    offset_bound_rect=off_perimeter_bound_rects,
    shapes=final_all_shapes,
    doors=final_doors,
    glazing=final_glazing,
    gv=gv)  # -> codes_i_bounds_i_2, shapes_i_codes_i_2, texts_i_shapes_i_2, shapes_i_texts_i_2, doors_i_shapes_i_2, shapes_i_doors_i_2, glazing_i_shapes_i_2, shapes_i_glazing_i_2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

# ----
# If the geometry is correctly implemented, there should be one GV for each shape. In other words, each point of the graph should be inside a different shape (closed curve). In practice, this means that these two lists panels below should have two lists with size n. If the panel on the right is a data tree, find the path where there are more or less than one item. Use these paths to find where the geometry is incorrect in Rhino
panel_3 = Panel("sanity check")
panel_4 = Panel(mapindices.gv_i_shapes_i_2)
len = ListLength(List=final_all_shapes)
n = Panel(len)
panel_5 = Panel(mapindices.shapes_i_gv_i_2)

# ----
# step 4: create state action graph in OOP
# This Python component is a workaround. The cluster in GH eliminates empty branches. So I add Nulls to these branches outside of the cluster and inside I will clean them.
gv_i_shapes_i = Integer(mapindices.gv_i_shapes_i_2)
idg_2 = Number(idg)
gv_2 = Point(gv)
groups = Integer(mapindices.shapes_in_bounds_indices_2)
dg_2 = Number(dg)
start_node_5 = Point(final_start_node)
python = GhPythonScript(DG=dg_2, IDG=idg_2)  # -> out, newDG, newIDG; inputs DG: tree of Int32, IDG: tree of Int32
# ---------- python: Python ----------
__author__ = "Pedro"
__version__ = "2018.06.25"

import Rhino.Geometry as rg
import rhinoscriptsyntax as rs
from Grasshopper.Kernel.Data import GH_Path
from Grasshopper import DataTree
import Grasshopper


def fillNones(tree):
    for path in tree.Paths:
        if len(tree.Branch(path)) == 0:
            tree.Branch(path).Add(None)
        print(path[0], tree.Branch(path))
    return tree

newDG = fillNones(DG)
newIDG = fillNones(IDG)
# ---------- end python ----------
oop_state_action_graph = OOPStateActionGraph(dg=python.newDG, idg=python.newIDG, gv=gv_2, gv_i_shapes_i=gv_i_shapes_i, groups=groups, start_node=start_node_5)  # -> nodes_2, root_i_2, start_node_i_2

# ----
# step 5: translate elements to origin and shapes i
move_to_origin_and_shapes_i = MoveToOriginAndShapesI(
    perimeters=final_perimeters,
    origin_pts_2=origin_pts,
    bounds_in_shapes_i=mapindices.bounds_in_shapes_indices_2,
    shafts=final_shafts,
    origin_pts_3=origin_pts,
    bounds_in_shapes_i_2=mapindices.bounds_in_shapes_indices_2,
    start_node_i=oop_state_action_graph.start_node_i_2,
    columns=final_columns,
    all_shapes=final_all_shapes,
    origin_pts_4=origin_pts,
    bounds_in_shapes_i_3=mapindices.bounds_in_shapes_indices_2,
    doors=final_doors,
    shapes_i_doors_i=mapindices.shapes_i_doors_i_2,
    origin_pts=origin_pts,
    bounds_in_shapes_indices_2=mapindices.bounds_in_shapes_indices_2,
    all_glazings=final_glazing,
    shapes_i_glazing_i=mapindices.shapes_i_glazing_i_2,
    bounds_in_shapes_indices=mapindices.bounds_in_shapes_indices_2,
    origin_pts_9=origin_pts,
    names=final_names,
    shapes_i_texts_i=mapindices.shapes_i_texts_i_2,
    codes=final_codes,
    codes_i_bounds_i=mapindices.codes_i_bounds_i_2,
    bounds_in_shapes_indices_3=mapindices.bounds_in_shapes_indices_2)  # -> perimeters_at_origin_3, shafts_at_origin_2, columns_at_origin_2, all_shapes_at_origin_2, all_doors_at_origin_2, all_glazings_at_origin_2, names_in_shape_i_2, codes_in_shape_i_2

# ----
# visualization of the layouts
# step 6a: create file for processing
columns_5 = Slider(11, range=1..50)
margin = Slider(514, range=0..2000)
perimeter_bound_rects_2 = Curve(perimeter_bound_rects)
pt = Point(<point referenced from the Rhino model>)
nodes = Data(oop_state_action_graph.nodes_2)
# This version does not contain the integration with a GUI.
root_i = Integer(oop_state_action_graph.root_i_2)
display_layouts = DisplayLayouts(
    all_shapes_at_origin=move_to_origin_and_shapes_i.all_shapes_at_origin_2,
    pt=pt,
    perimeter_bound_rects=perimeter_bound_rects_2,
    margins=margin,
    columns=columns_5,
    nodes=nodes,
    root_i=root_i)  # -> shapes_i_floorplans_i_2, G

# ---- group: display flooplans
# these tags are in Portuguesse. Sorry... did not have time to translate them.
shapes_i_floorplans_i = Integer(display_layouts.shapes_i_floorplans_i_2)
shapes_i_texts_i = Integer(mapindices.shapes_i_texts_i_2)
final_names_2 = Text(final_names)
floorplans = Curve(display_layouts.G)
pcen = PolygonCenter(Polyline=floorplans)  # -> CenterV, CenterE, CenterA
item = ListItem(List=shapes_i_texts_i, Index=shapes_i_floorplans_i, Wrap=True)
item_2 = ListItem(List=final_names_2, Index=item, Wrap=True)
pt_2 = Point(pcen.CenterA)
tag = TextTag3D(Location=pt_2, Text=item_2, Size=50, Justification=8)

# ---- group: indices from processing via UDP
panel_6 = Panel("127.0.0.8")  # disabled
panel_7 = Panel("9000")  # disabled
udp = UDPReceiver(Address=panel_6, Port=panel_7, Pattern=0)  # -> Info, Data; disabled
panel_8 = Panel(",")  # disabled
split = TextSplit(Text=udp.Data, Separators=panel_8)  # disabled
int = Integer(split)  # disabled

# ---- group: indices from processing via file
panel_9 = Panel("C:\Users\Pedro\Documents\2018 research\grammar paper\nexo_customizer5\shapesToGH.csv")
file = ReadFile(File=panel_9, PerLineParse=True)

# ----
panel_10 = Panel(file)

# ----
# If you want to integrate this definition with a GUI, here is the moment to provide the indices for the selected shapes
panel_11 = Panel("sanity check")

# ---- group: choose method
value_list = ValueList({"File": 0, "UDP": 1}, selected="File")
int_2 = Integer(panel_10)
filter_2 = StreamFilter(Gate=value_list, Stream0=int_2, Stream1=int)
split_2 = SplitList(List=filter_2, Index=1)  # -> ListA, ListB
grammar_i_2 = Integer(split_2.ListA)
shapes_i = Integer(split_2.ListB)

# ---- group: currrent doors
cur_shapes_i = Integer(shapes_i)
doors_5 = Curve(reparameterize(move_to_origin_and_shapes_i.all_doors_at_origin_2))
branch = TreeBranch(Tree=doors_5, Path=cur_shapes_i, MaintainPaths=True)
cur_doors = Curve(branch)

# ---- group: current shapes
# step 6b: get shapes from processing to GH-BIM
all_shapes = Curve(move_to_origin_and_shapes_i.all_shapes_at_origin_2)
cur_shapes_i_2 = Integer(shapes_i)
item_3 = ListItem(List=all_shapes, Index=cur_shapes_i_2, Wrap=True)
cur_shapes = Curve(item_3)

# ---- group: current shapes on graph
all_shapes_2 = Curve(final_all_shapes)  # disabled
cur_shapes_i_3 = Integer(shapes_i)  # disabled
item_4 = ListItem(List=all_shapes_2, Index=cur_shapes_i_3, Wrap=True)  # disabled
Z = UnitZ(Factor=500)  # disabled
extr = Extrude(Base=item_4, Direction=Z)  # disabled

# ---- group: current glazing
cur_shapes_i_4 = Integer(shapes_i)
glazing_5 = Curve(reparameterize(move_to_origin_and_shapes_i.all_glazings_at_origin_2))
branch_2 = TreeBranch(Tree=glazing_5, Path=cur_shapes_i_4, MaintainPaths=True)
glazing_6 = Curve(branch_2)

# ---- group: current apt
grammar_i_3 = Integer(grammar_i_2)  # disabled
txt = Text()  # disabled
item_5 = ListItem(List=txt, Index=grammar_i_3, Wrap=True)  # disabled
panel_12 = Panel(item_5)  # disabled

# ---- group: fixed elements
columns_6 = Curve(reparameterize(move_to_origin_and_shapes_i.columns_at_origin_2))
# step 6c: filter geometries to BIM
shafts_5 = Curve(reparameterize(move_to_origin_and_shapes_i.shafts_at_origin_2))

# ---- group: extract walls
# this part is using the components from Karamba to extract the lines of the walls.
cur_shapes_2 = Curve(cur_shapes)
number_slider = Slider(0.2, range=0..1)
explode = Explode(Curve=cur_shapes_2, Recursive=True)  # -> flatten(Segments), Vertices
llinter = LineLineIntersectionKaramba(Line=explode.Segments, LengthTolerance=number_slider)  # -> IntersectionPoints, LineSubSegements
rdlines = RemoveDuplicateLinesKaramba(Line=flatten(llinter.LineSubSegements), LimitDistance=number_slider)  # -> OutLine, Info, Indexes
walls = Curve(reparameterize(flatten(rdlines.OutLine)))

# ---- group: map doors walls
# create a map between the index of the dooors and the index of the wall lines
walls_2 = Curve(reparameterize(flatten(walls)))
cur_doors_2 = Curve(cur_doors)
clean = CleanTree(RemoveNulls=True, RemoveInvalid=True, RemoveEmpty=False, Tree=cur_doors_2)
flatten = FlattenTree(Tree=clean, Path="{0}")
mapcurvewall = MapCurveWall(curves=flatten, walls=walls_2)

# ---- group: map windows walls
# create a map between the index of the windows and the index of the wall lines
cur_windows = Curve(glazing_6)
walls_3 = Curve(reparameterize(flatten(walls)))
clean_2 = CleanTree(RemoveNulls=True, RemoveInvalid=True, RemoveEmpty=False, Tree=cur_windows)
flatten_2 = FlattenTree(Tree=clean_2, Path="{0}")
mapcurvewall_2 = MapCurveWall(curves=flatten_2, walls=walls_3)

# ---- group: intersection of windows and walls
# use this map to filter the walls that will have a window
map_curve_wall = Number(mapcurvewall_2)
cur_windows_2 = Curve(flatten(flatten_2))
flatten_3 = FlattenTree(Tree=map_curve_wall, Path="{0}")
walls_4 = Curve(walls)
item_6 = ListItem(List=walls_4, Index=flatten_3, Wrap=True)
ccx = CurveCurve(CurveA=cur_windows_2, CurveB=item_6)  # -> Points, ParamsA, ParamsB
darc = DeconstructArc(Arc=cur_windows_2)  # -> BasePlane, Radius, Angle
item_7 = ListItem(List=ccx.Points, Index=0, Wrap=True)  # -> Item, Item1

# ---- group: project wall start and end points on the walls
# use this map to filter the walls that will have a door
map_curve_wall_2 = Number(mapcurvewall)
cur_doors_3 = Curve(flatten(flatten))
flatten_4 = FlattenTree(Tree=map_curve_wall_2, Path="{0}")
walls_5 = Curve(walls)
item_8 = ListItem(List=walls_5, Index=flatten_4, Wrap=True)
end = EndPoints(Curve=cur_doors_3)  # -> Start, End
crv_cp = CurveClosestPoint(Point=end.Start, Curve=item_8)  # -> Point, Parameter, Distance
crv_cp_2 = CurveClosestPoint(Point=end.End, Curve=item_8)  # -> Point, Parameter, Distance
darc_2 = DeconstructArc(Arc=cur_doors_3)  # -> BasePlane, Radius, Angle

# ---- group: doors
# list with points of the doors and the map to filter the wall lines associated with each door
map_curve_wall_3 = Number(flatten(map_curve_wall_2))
start_on_wall = Point(crv_cp.Point)
center = Point(darc_2.BasePlane)
end_on_wall = Point(crv_cp_2.Point)

# ---- group: windows
# list with points of the windows and the map to filter the wall lines associated with each door
map_curve_wall_4 = Number(flatten(map_curve_wall))
start_on_wall_2 = Point(item_7.Item)
end_on_wall_2 = Point(item_7.Item1)
center_2 = Point(darc.BasePlane)

# ----
# list with all the wall lines
walls_6 = Curve(walls)

columns_7 = Curve(reparameterize(columns_6))
glazing_7 = Curve(reparameterize(glazing_6))
doors_6 = Curve(reparameterize(cur_doors))
walls_7 = Curve(reparameterize(walls_6))
slab = Curve(reparameterize(cur_shapes))
shaft = Curve(shafts_5)

# ---- group: Archicad Synchronizer
# step 8: generate BIM elements
boolean_toggle = BooleanToggle(False)

# ----
wall_analysis = Panel(walls_7)
doors_analysis = Panel(doors_6)
slab_analysis = Panel(slab)
glazing_analysis = Panel(glazing_7)
composite = Composite(AC_Composite=(2, 0, -1))
number_slider_2 = Slider(295, range=0..1000)
number_slider_3 = Slider(16, range=0..100)
composite_2 = Composite(AC_Composite=(2, 0, -1))
building_material = BuildingMaterial(AC_BuildingMaterial=(2, 0, -1))
merge = Merge(Data1=Slider(5, range=0..7), Data2=Slider(6, range=0..7))
wallsetb = WallSettingsBasic(
    BuildingMaterial=building_material,
    Height=number_slider_2,
    Thickness=number_slider_3,
    Position="1",
    BuildingMaterial_2=building_material,
    Height_2=number_slider_2,
    Thickness_2=number_slider_3,
    Position_2="1",
    AC_ActiveState_Name="BasicSlanted")
merge_2 = Merge(Data1=Slider(5, range=0..7), Data2=Slider(6, range=0..7))
slabsetc = SlabSettingsComposite(Composite=composite, Composite_2=composite, AC_ActiveState_Name="Composite")
slabsetc_2 = SlabSettingsComposite(Composite=composite_2, Composite_2=composite_2, AC_ActiveState_Name="Composite")
list_item = ListItem(List=slab, Index=merge_2, Wrap=True)
cull_index = CullIndex(List=slab, Indices=merge, Wrap=True)
merge_3 = Merge(Data1=Slider(2, range=0..7), Data2=Slider(3, range=0..7), Data3=Slider(5, range=0..7), Data4=Slider(6, range=0..7))
slab_2 = Slab(Synchronize=boolean_toggle, Polygon=cull_index, SlabSettings=slabsetc)
slab_3 = Slab(Synchronize=boolean_toggle, Polygon=list_item, SlabSettings=slabsetc_2)
list_item_2 = ListItem(List=columns_7, Index=merge_3, Wrap=True)
wall = Wall(Synchronize=boolean_toggle, Curve=walls_7, WallSettings=wallsetb)
list_item_3 = ListItem(List=columns_7, Index=Slider(4, range=0..7), Wrap=True)
number_slider_4 = Slider(30, range=0..50)
number_slider_5 = Slider(1.5, range=0..30)
number_slider_6 = Slider(0, range=0..100)
number_slider_7 = Slider(30, range=0..50)
number_slider_8 = Slider(1.5, range=0..30)
number_slider_9 = Slider(90, range=0..100)
building_material_2 = BuildingMaterial(AC_BuildingMaterial=(2, 0, -1))
building_material_3 = BuildingMaterial(AC_BuildingMaterial=(2, 0, -1))
list_item_4 = ListItem(List=shaft, Index=Slider(0, range=0..1), Wrap=True)
columnsetr = ColumnSettingsRectangular(
    BuildingMaterial=building_material_2,
    CoreDimension1=number_slider_4,
    CoreDimension2=number_slider_5,
    RotationAngle=degrees(number_slider_6),
    BuildingMaterial_2=building_material_2,
    CoreDimension1_2=number_slider_4,
    CoreDimension2_2=number_slider_5,
    RotationAngle_2=degrees(number_slider_6),
    AC_ActiveState_Name="Rectangular")
window_settings = WindowSettings(SillHeight="120")  # -> WindowSettings, LibraryPart
columnsetr_2 = ColumnSettingsRectangular(
    BuildingMaterial=building_material_3,
    CoreDimension1=number_slider_7,
    CoreDimension2=number_slider_8,
    RotationAngle=degrees(number_slider_9),
    BuildingMaterial_2=building_material_3,
    CoreDimension1_2=number_slider_7,
    CoreDimension2_2=number_slider_8,
    RotationAngle_2=degrees(number_slider_9),
    AC_ActiveState_Name="Rectangular")
door_settings = DoorSettings(SillHeight="0")  # -> DoorSettings, LibraryPart
list_item_5 = ListItem(List=wall, Index=map_curve_wall_3, Wrap=True)
point_on_curve = PointOnCurve(doors_6, parameter=0.5)
polygon_center = PolygonCenter(Polyline=list_item_4)  # -> CenterV, CenterE, CenterA
polygon_center_2 = PolygonCenter(Polyline=list_item_3)  # -> CenterV, CenterE, CenterA
list_item_6 = ListItem(List=wall, Index=map_curve_wall_4, Wrap=True)
polygon_center_3 = PolygonCenter(Polyline=list_item_2)  # -> CenterV, CenterE, CenterA
window_point = WindowPoint(
    Synchronize=boolean_toggle,
    Wall=list_item_6,
    InsertionPoint=center_2,
    Orientation=polygon_center.CenterV,
    RevealSide=True,
    WindowSettings=window_settings.WindowSettings,
    AC_Window_Point=(2, 0, 0))
column = Column(Synchronize=boolean_toggle, AnchorPoint=polygon_center_3.CenterV, ColumnSettings=columnsetr_2)
column_2 = Column(Synchronize=boolean_toggle, AnchorPoint=polygon_center_2.CenterV, ColumnSettings=columnsetr)
door_point = DoorPoint(
    Synchronize=boolean_toggle,
    Wall=list_item_5,
    InsertionPoint=center,
    Orientation=point_on_curve,
    RevealSide=True,
    DoorSettings=door_settings.DoorSettings,
    AC_Door_Point=(2, 0, 0))

# ==== cluster MapIndices
names_origins = ClusterInput()
offset_bound_rect = ClusterInput()
codes_origins = ClusterInput()
glazing = ClusterInput()
gv = ClusterInput()
doors = ClusterInput()
shapes = ClusterInput()
offset_bound_rect_2 = Curve(offset_bound_rect)
names_origins_2 = Point(names_origins)
codes_origins_2 = Point(codes_origins)
glazing_2 = Curve(glazing)
gv_2 = Point(gv)
doors_2 = Curve(doors)
shapes_2 = Curve(shapes)

# ---- group: mapping perimeter: glazing
shapes_3 = Curve(shapes_2)
glazing_3 = Curve(glazing_2)
area = Area(Geometry=glazing_3)  # -> Area, Centroid
map_point_curve_special = MapPtCrv(points=area.Centroid, boundaries=shapes_3)  # -> type_2, point_curve_2, curve_point_2, has_lost_values_2
panel = Panel(map_point_curve_special.type_2)
panel_2 = Panel(map_point_curve_special.point_curve_2)
panel_3 = Panel(map_point_curve_special.curve_point_2)
add_null_to_empty_branches = PythonScript(t=panel_3)  # -> out, a; inputs t: tree
# ---------- add_null_to_empty_branches: Python ----------
from Grasshopper.Kernel.Data import GH_Path
from Grasshopper import DataTree

for path in t.Paths:
    if len(t.Branch(path)) == 0:
        t.Add(None, path)
a = t
# ---------- end add_null_to_empty_branches ----------

# ---- group: mapping doors: graph
shapes_4 = Curve(shapes_2)
doors_3 = Curve(doors_2)
eval = EvaluateCurve(Curve=doors_3, Parameter=".5")  # -> Point, Tangent, Angle
map_point_curve = MapPtCrv_2(points=eval.Point, boundaries=shapes_4)  # -> type_2, point_curve_2, curve_point_2, has_lost_values_2
panel_4 = Panel(map_point_curve.type_2)
panel_5 = Panel(map_point_curve.point_curve_2)
panel_6 = Panel(map_point_curve.curve_point_2)
add_null_to_empty_branches_2 = PythonScript(t=panel_6)  # -> out, a; inputs t: tree; same code as add_null_to_empty_branches

# ---- group: mappig shapes:graph
gv_3 = Point(gv_2)
shapes_5 = Curve(shapes_2)
map_point_curve_2 = MapPtCrv_2(points=gv_3, boundaries=shapes_5)  # -> type_2, point_curve_2, curve_point_2, has_lost_values_2
panel_7 = Panel(map_point_curve_2.type_2)
panel_8 = Panel(map_point_curve_2.point_curve_2)
panel_9 = Panel(map_point_curve_2.curve_point_2)

# ---- group: mapping shapes:texts
shapes_6 = Curve(shapes_2)
origins = Point(names_origins_2)
map_point_curve_3 = MapPtCrv_2(points=origins, boundaries=shapes_6)  # -> type_2, point_curve_2, curve_point_2, has_lost_values_2
panel_10 = Panel(map_point_curve_3.type_2)
panel_11 = Panel(map_point_curve_3.point_curve_2)
panel_12 = Panel(map_point_curve_3.curve_point_2)
add_null_to_empty_branches_3 = PythonScript(t=panel_12)  # -> out, a; inputs t: tree; same code as add_null_to_empty_branches

# ----
item = ListItem(List=gv_3, Index="37", Wrap=True)

# ---- group: mapping shapes:texts
offset_bound_rect_3 = Curve(offset_bound_rect_2)
origins_2 = Point(codes_origins_2)
map_point_curve_4 = MapPtCrv_2(points=origins_2, boundaries=offset_bound_rect_3)  # -> type_2, point_curve_2, curve_point_2, has_lost_values_2
panel_13 = Panel(map_point_curve_4.type_2)
panel_14 = Panel(map_point_curve_4.curve_point_2)
panel_15 = Panel(map_point_curve_4.point_curve_2)

# ----
glazing_i_shapes_i = Integer(panel_2)
shapes_i_glazing_i = Integer(add_null_to_empty_branches.a)
codes_i_bounds_i = Integer(panel_15)
doors_i_shapes_i = Integer(panel_5)
shapes_i_texts_i = Integer(add_null_to_empty_branches_3.a)
shapes_i_codes_i = Integer(panel_14)
texts_i_shapes_i = Integer(panel_11)
gv_i_shapes_i = Integer(panel_8)
shapes_i_gv_i = Integer(panel_9)
shapes_i_glazing_i_2 = ClusterOutput(shapes_i_glazing_i)
glazing_i_shapes_i_2 = ClusterOutput(glazing_i_shapes_i)
gv_i_shapes_i_2 = ClusterOutput(gv_i_shapes_i)
shapes_i_texts_i_2 = ClusterOutput(shapes_i_texts_i)
shapes_i_gv_i_2 = ClusterOutput(shapes_i_gv_i)
texts_i_shapes_i_2 = ClusterOutput(texts_i_shapes_i)
shapes_i_doors_i = Integer(add_null_to_empty_branches_2.a)
doors_i_shapes_i_2 = ClusterOutput(doors_i_shapes_i)
shapes_i_doors_i_2 = ClusterOutput(shapes_i_doors_i)
shapes_i_codes_i_2 = ClusterOutput(shapes_i_codes_i)
codes_i_bounds_i_2 = ClusterOutput(codes_i_bounds_i)

# ---- group: mappig counds:shapes
offset_bound_rect_4 = Curve(offset_bound_rect_2)
shapes_7 = Curve(shapes_2)

# ----
area_2 = Area(Geometry=shapes_7)  # -> Area, Centroid

# ---- group: mappig counds:shapes (continued)
map_point_curve_5 = MapPtCrv_2(points=area_2.Centroid, boundaries=offset_bound_rect_4)  # -> type_2, point_curve_2, curve_point_2, has_lost_values_2
panel_16 = Panel(map_point_curve_5.type_2)
panel_17 = Panel(map_point_curve_5.point_curve_2)
panel_18 = Panel(map_point_curve_5.curve_point_2)
add_null_to_empty_branches_4 = PythonScript(t=panel_18)  # -> out, a; inputs t: tree; same code as add_null_to_empty_branches

# ----
bounds_in_shapes_indices = Integer(panel_17)
shapes_in_bounds_indices = Integer(add_null_to_empty_branches_4.a)
bounds_in_shapes_indices_2 = ClusterOutput(bounds_in_shapes_indices)
shapes_in_bounds_indices_2 = ClusterOutput(shapes_in_bounds_indices)

# ==== cluster TreatRhinoInput
fixed_shapes = ClusterInput()
final_connections = ClusterInput()
start_node = ClusterInput()
shapes = ClusterInput()
perimeters = ClusterInput()
final_glazing = ClusterInput()
columns = ClusterInput()
shafts = ClusterInput()
names = ClusterInput()
doors = ClusterInput()
codes = ClusterInput()

# ---- group: get bounding rectangle for perimeters
perimeters_2 = Curve(perimeters)
bbox = BoundingBox(Content=perimeters_2, Plane=PlaneXY(0, 0, 0))  # -> Box, Box_2
edges = BrepEdges(Brep=bbox.Box)  # -> Naked, Interior, NonManifold
join = JoinCurves(Curves=edges.Naked, Preserve=False)
flatten = FlattenTree(Tree=join, Path="{0}")
perimter_bound_rects = Curve(flatten)

# ---- group: consistent pt ordering
columns_2 = Curve(columns)
fixed_shapes_2 = Curve(fixed_shapes)
shapes_2 = Curve(shapes)
shafts_2 = Curve(shafts)
rectangle = Rectangle(Plane=PlaneXY(0, 0, 0), XSize=Domain(-1, 1), YSize=Domain(-2, 2), Radius=0)  # -> Rectangle, Length
flip = FlipCurve(Curve=fixed_shapes_2, Guide=rectangle.Rectangle)  # -> Curve, Flag
flip_2 = FlipCurve(Curve=shapes_2, Guide=rectangle.Rectangle)  # -> Curve, Flag
flip_3 = FlipCurve(Curve=columns_2, Guide=rectangle.Rectangle)  # -> Curve, Flag
flip_4 = FlipCurve(Curve=shafts_2, Guide=rectangle.Rectangle)  # -> Curve, Flag
final_columns = Curve(flip_3.Curve)
final_fixed_shapes = Curve(flip.Curve)
final_shafts = Curve(flip_4.Curve)

# ---- group: offset bounding rect to avoid errors
perimeters_bound_rect = Curve(flatten)
allowed_error = Panel("100")
offset = Offset(Curve=perimeters_bound_rect, Distance=allowed_error, Plane=PlaneXY(0, 0, 0), Corners=1)  # -> flatten(Curve)
off_perimeter_bound_rects = Curve(offset)

# ---- group: extract text and origin from GUID
codes_2 = Guid(codes)
names_2 = Guid(names)
guidtotextandpt = PythonScript(names=codes_2)  # -> out, texts, origins; inputs names: list
# ---------- guidtotextandpt: Python ----------
import rhinoscriptsyntax as rs
import Rhino as rh
import scriptcontext as sc

# Set the script context to the current Rhino doc
sc.doc = rh.RhinoDoc.ActiveDoc

# corrections
dict = {"var.": "varanda", "varan.": "varanda", "shf": "shaft", "shf.": "shaft", 
"s":"shaft", "s.": "shaft", "ban": "banheiro", "ban.": "banheiro", "banh.": "banheiro", 
"dorm.": "dormitório", "coz.": "cozinha", "serv.": "serviço", "lav.": "lavabo",
"clos.": "closet", "suit.": "suíte", "circ.": "circulação"}

# Do your Rhino doc business...
tObj2 = []
origins = []
texts = []
if names:
    for i in range(len(names)):
        tObj2.append(rs.coercerhinoobject(names[i]))
        texts.append(tObj2[i].DisplayText)
        
#        if name[i] in dict:
#            name[i] = dict[name[i]]
        if "\n" in texts[i]: #why destructive method does not work in place?
            clone = texts[i].replace('\r', ' ')
            clone2 = clone.replace('\n', '')
            texts[i] = clone2
        origins.append(tObj2[i].Geometry.Plane.Origin)

# Then set the script context back to the Grasshopper doc
sc.doc = ghdoc
# ---------- end guidtotextandpt ----------
guidtotextandpt_2 = PythonScript(names=names_2)  # -> out, texts, origins; inputs names: list; same code as guidtotextandpt
final_names = Text(guidtotextandpt_2.texts)
final_names_pt = Point(guidtotextandpt_2.origins)
final_codes_pt = Text(guidtotextandpt.origins)
final_codes = Text(guidtotextandpt.texts)

# ---- group: invariants
final_perimeters = Curve(perimeters)
final_connections_2 = Curve(final_connections)
final_glazing_2 = Curve(final_glazing)
start_node_2 = Point(start_node)
doors_2 = Curve(doors)

# ---- group: get top left corner of perimeters
perimeters_bound_rect_2 = Curve(perimter_bound_rects)
cp = ControlPoints(Curve=perimeters_bound_rect_2)  # -> Points, Weights, Knots
bottom_left_point = ListItem(List=cp.Points, Index=Slider(3, range=0..4), Wrap=True)
flatten_2 = FlattenTree(Tree=bottom_left_point, Path="{0}")
origin_pts = Point(flatten_2)

# ----
final_shafts_2 = ClusterOutput(final_shafts)
final_perimeters_2 = ClusterOutput(final_perimeters)
final_columns_2 = ClusterOutput(final_columns)
doors_3 = ClusterOutput(doors_2)
off_perimeter_bound_rects_2 = ClusterOutput(off_perimeter_bound_rects)
perimter_bound_rects_2 = ClusterOutput(perimter_bound_rects)
final_glazing_3 = ClusterOutput(final_glazing_2)
start_node_3 = ClusterOutput(start_node_2)
final_names_2 = ClusterOutput(final_names)
final_codes_2 = ClusterOutput(final_codes)
final_fixed_shapes_2 = ClusterOutput(final_fixed_shapes)
final_codes_pt_2 = ClusterOutput(final_codes_pt)
final_connections_3 = ClusterOutput(final_connections_2)
final_names_pt_2 = ClusterOutput(final_names_pt)
origin_pts_2 = ClusterOutput(origin_pts)

# ---- group: merge fixed and variable shapes
consistent_shapes = Curve(flip_2.Curve)
merge = Merge(Data1=consistent_shapes, Data2=flip.Curve)

# ----
cp_2 = ControlPoints(Curve=merge)  # -> Points, Weights, Knots

# ---- group: merge fixed and variable shapes (continued)
rdpoints = RemoveDuplicatePointsKaramba(Point=cp_2.Points, LimitDistance=0.005)  # -> OutPoint, Info, Indexes
pline = PolyLine(Vertices=rdpoints.OutPoint, Closed=True)  # -> simplify(flatten(Polyline))
final_all_shapes = Curve(pline)

# ----
final_all_shapes_2 = ClusterOutput(final_all_shapes)

# ==== cluster MoveToOriginAndShapesI
bounds_in_shapes_indices = ClusterInput()
shapes_i_glazing_i = ClusterInput()
bounds_in_shapes_indices_2 = ClusterInput()
all_glazings = ClusterInput()
shapes_i_doors_i = ClusterInput()
origin_pts = ClusterInput()
doors = ClusterInput()
perimeters = ClusterInput()
origin_pts_2 = ClusterInput()
bounds_in_shapes_i = ClusterInput()
bounds_in_shapes_i_2 = ClusterInput()
columns = ClusterInput()
shafts = ClusterInput()
start_node_i = ClusterInput()
origin_pts_3 = ClusterInput()
bounds_in_shapes_i_3 = ClusterInput()
all_shapes = ClusterInput()
origin_pts_4 = ClusterInput()
shapes_i_doors_i_2 = Integer(shapes_i_doors_i)
names = ClusterInput()
codes = ClusterInput()
bounds_in_shapes_indices_3 = ClusterInput()
shapes_i_texts_i = ClusterInput()
codes_i_bounds_i = ClusterInput()

# ---- group: change origin pts to shape i
bounds_in_shapes_i_4 = Integer(bounds_in_shapes_i_3)
origin_pts_5 = Point(origin_pts_4)
item = ListItem(List=origin_pts_5, Index=bounds_in_shapes_i_4, Wrap=True)
all_shapes_origin_pts = Point(item)

# ---- group: find origin in starting perimeter in shape i
bounds_in_shapes_i_5 = Integer(bounds_in_shapes_i_2)
start_node_i_2 = Integer(start_node_i)
origin_pts_6 = Point(origin_pts_3)
item_2 = ListItem(List=bounds_in_shapes_i_5, Index=start_node_i_2, Wrap=True)
item_3 = ListItem(List=origin_pts_6, Index=item_2, Wrap=True)
origin_pt_start_node = Point(item_3)

# ---- group: move perimeters to origin
# this is kind of stupid because the perimeters are the same, but I still do it for generalization for future cases
origin_pts_7 = Point(origin_pts_2)
perimeters_2 = Curve(perimeters)
rev = Reverse(Vector=origin_pts_7)
move = Move(Geometry=perimeters_2, Motion=rev)  # -> Geometry, Transform
perimeters_at_origin = Curve(move.Geometry)

# ---- group: get origin points respective to doors in shape i
# THIS STEP CAN BE AVOIDED IF WE CREATE A MAP FROM DOORS TO BOUNDS... BUT THIS MIGHT ADD TOO MUCH COMPUTATION
bounds_in_shapes_indices_4 = Integer(bounds_in_shapes_indices_2)
shapes_i_doors_i_3 = Integer(shapes_i_doors_i_2)
graft = GraftTree(Tree=bounds_in_shapes_indices_4, IncludeEmptyLists=True, IncludeNullItems=True)  # -> simplify(Tree)
lng = ListLength(List=shapes_i_doors_i_3)
repeat = RepeatData(Data=graft, Length=lng)  # -> simplify(Data)
origin_pts_8 = Point(origin_pts)
item_4 = ListItem(List=origin_pts_8, Index=repeat, Wrap=True)
doors_at_shape_i_o_pts = Point(item_4)

# ---- group: change glazings to shape i
shapes_i_glazing_i_2 = Integer(shapes_i_glazing_i)
all_glazings_2 = Curve(all_glazings)
item_5 = ListItem(List=all_glazings_2, Index=shapes_i_glazing_i_2, Wrap=True)
glazing_in_shapes = Curve(reparameterize(item_5))

# ---- group: change names to shape i
shapes_i_texts_i_2 = Integer(shapes_i_texts_i)
names_2 = Text(names)
item_6 = ListItem(List=names_2, Index=shapes_i_texts_i_2, Wrap=True)
remove_path_1 = PythonScript(t=item_6)  # -> out, a; inputs t: tree
# ---------- remove_path_1: Python ----------
from Grasshopper.Kernel.Data import GH_Path

t.RemovePath(GH_Path(-1))
a = t
# ---------- end remove_path_1 ----------
flatten = FlattenTree(Tree=remove_path_1.a, Path="{0}")
names_in_shape_i = Text(flatten)

# ----
origin_pts_9 = ClusterInput()

# ---- group: get origin points respective to doors in shape i
# THIS STEP CAN BE AVOIDED IF WE CREATE A MAP FROM GLAZING TO BOUNDS... BUT THIS MIGHT ADD TOO MUCH COMPUTATION
bounds_in_shapes_indices_5 = Integer(bounds_in_shapes_indices)
shapes_i_glazing_i_3 = Integer(shapes_i_glazing_i)
graft_2 = GraftTree(Tree=bounds_in_shapes_indices_5, IncludeEmptyLists=True, IncludeNullItems=True)  # -> simplify(Tree)
lng_2 = ListLength(List=shapes_i_glazing_i_3)
repeat_2 = RepeatData(Data=graft_2, Length=lng_2)  # -> simplify(Data)
origin_pts_10 = Point(origin_pts_9)
item_7 = ListItem(List=origin_pts_10, Index=repeat_2, Wrap=True)
glazing_at_shape_i_o_pts = Point(item_7)

# ---- group: change codes to shape i
bounds_in_shapes_indices_6 = Integer(bounds_in_shapes_indices_3)
codes_i_bounds_i_2 = Integer(codes_i_bounds_i)
codes_2 = Text(codes)
item_8 = ListItem(List=codes_i_bounds_i_2, Index=bounds_in_shapes_indices_6, Wrap=True)
item_9 = ListItem(List=codes_2, Index=item_8, Wrap=True)
codes_in_shape_i = Text(item_9)

# ---- group: change doors to shape i
shapes_i_doors_i_4 = Integer(shapes_i_doors_i_2)
doors_2 = Curve(reparameterize(doors))
item_10 = ListItem(List=doors_2, Index=shapes_i_doors_i_4, Wrap=True)
doors_in_shapes = Curve(reparameterize(item_10))

# ---- group: change perimters to shape i
# convert to shape indices
bounds_in_shapes_i_6 = Integer(bounds_in_shapes_i)
item_11 = ListItem(List=perimeters_at_origin, Index=bounds_in_shapes_i_6, Wrap=True)
perimeters_at_origin_2 = Curve(item_11)

# ---- group: move shapes to origin
rev_2 = Reverse(Vector=all_shapes_origin_pts)
all_shapes_2 = Curve(all_shapes)
move_2 = Move(Geometry=all_shapes_2, Motion=rev_2)  # -> Geometry, Transform
all_shapes_at_origin = Curve(move_2.Geometry)

# ---- group: move columns to origin
rev_3 = Reverse(Vector=origin_pt_start_node)
columns_2 = Curve(columns)
move_3 = Move(Geometry=columns_2, Motion=rev_3)  # -> Geometry, Transform
columns_at_origin = Curve(move_3.Geometry)

# ---- group: move shafts to origin
rev_4 = Reverse(Vector=origin_pt_start_node)
shafts_2 = Curve(shafts)
move_4 = Move(Geometry=shafts_2, Motion=rev_4)  # -> Geometry, Transform
shafts_at_origin = Curve(move_4.Geometry)

# ---- group: move doors
rev_5 = Reverse(Vector=doors_at_shape_i_o_pts)
move_5 = Move(Geometry=doors_in_shapes, Motion=rev_5)  # -> simplify(Geometry), Transform
all_doors_at_origin = Curve(move_5.Geometry)

# ---- group: move glazing
rev_6 = Reverse(Vector=glazing_at_shape_i_o_pts)
move_6 = Move(Geometry=glazing_in_shapes, Motion=rev_6)  # -> simplify(Geometry), Transform
all_glazings_at_origin = Curve(move_6.Geometry)

# ----
codes_in_shape_i_2 = ClusterOutput(codes_in_shape_i)
names_in_shape_i_2 = ClusterOutput(names_in_shape_i)
shafts_at_origin_2 = ClusterOutput(shafts_at_origin)
columns_at_origin_2 = ClusterOutput(columns_at_origin)
all_shapes_at_origin_2 = ClusterOutput(all_shapes_at_origin)
all_doors_at_origin_2 = ClusterOutput(all_doors_at_origin)
all_glazings_at_origin_2 = ClusterOutput(all_glazings_at_origin)
perimeters_at_origin_3 = ClusterOutput(perimeters_at_origin_2)

# ==== cluster MapCurveWall
curves = ClusterInput()
walls = ClusterInput()
curves_2 = Curve(flatten(curves))
walls_2 = Curve(reparameterize(flatten(walls)))
darc = DeconstructArc(Arc=curves_2)  # -> BasePlane, Radius, Angle
graft = GraftTree(Tree=darc.BasePlane, IncludeEmptyLists=True, IncludeNullItems=True)
crv_cp = CurveClosestPoint(Point=simplify(graft), Curve=walls_2)  # -> Point, Parameter, Distance
dist = Distance(PointA=graft, PointB=crv_cp.Point)
smaller = SmallerThan(FirstNumber=dist, SecondNumber=Slider(1.1, range=0..10))  # -> SmallerThan, OrEqualTo
true = Boolean(True)
mindex = MemberIndex(Set=simplify(smaller.SmallerThan), Member=true)  # -> simplify(Index), Count
ccx = CurveCurve()  # -> Points, ParamsA, ParamsB
map_curve_wall = Number(mindex.Index)
panel = Panel(map_curve_wall)
item = ListItem(Index=0, Wrap=True)
map_curve_wall_2 = ClusterOutput(map_curve_wall)

# ==== cluster CreateGraph
connections = ClusterInput()
fixed_shapes = ClusterInput()

# ---- group: generate digraph
# add fixed shapes to graph (disconnected nodes)
connections_2 = Curve(connections)
fixed_shapes_2 = Curve(fixed_shapes)
cleansetoflines = CleanSetOfLines(Lines=connections_2)  # -> CleanedLines, IndicesRemoved, IndicesMapped
graphfromlines = GraphFromLines(ConnectionLines=cleansetoflines.CleanedLines)  # -> Graph, GraphDistances, GraphVertex
pcen = PolygonCenter(Polyline=fixed_shapes_2)  # -> CenterV, CenterE, CenterA
connections_3 = Curve(cleansetoflines.CleanedLines)
python = PythonScript(G=graphfromlines.Graph, GD=graphfromlines.GraphDistances, GV=graphfromlines.GraphVertex, fixed_centers=pcen.CenterV)  # -> out, newG, newGD, newGV; inputs G: tree of Int32, GD: tree, GV: list of Point3d, fixed_centers: list of Point3d
# ---------- python: Python ----------
from Grasshopper.Kernel.Data import GH_Path
from Grasshopper import DataTree



#1) update graph with disconnected points of fixed shapes
start_i = len(GV)
for i in range(start_i, start_i + len(fixed_centers)):
    G.EnsurePath(GH_Path(i))
    GD.EnsurePath(GH_Path(i))

#2) update list of centers with centers of fixed shapes
GV += fixed_centers

#3) transfer to output
newG = G
newGD = GD
newGV = GV
# ---------- end python ----------
gv = Point(python.newGV)
G = Integer(python.newG)

# ----
shapes = ClusterInput()
gv_2 = ClusterOutput(gv)
G_2 = ClusterOutput(G)

# ---- group: visualize
shapes_2 = Curve(shapes)
gv_3 = Point(gv)
G_3 = Integer(python.newG)
gv_4 = Point(gv)
pcen_2 = PolygonCenter(Polyline=shapes_2)  # -> CenterV, CenterE, CenterA
dg = DisplayGraph(Graph=G_3, GraphVertex=gv_4, Values=-1, Size=1, GraphColor=RGB(255, 20, 147))  # -> VRep, ConRep, GraphLines
points = PointList(Points=gv_3, Size=200)
points_2 = PointList(Points=pcen_2.CenterV, Size=100)

# ---- group: generated DGRAPHs for parents and children
connections_4 = Curve(connections_3)
G_4 = Integer(G)
cp = ControlPoints(Curve=connections_4)  # -> Points, Weights, Knots
gv_5 = Point(gv)
cp_2 = ClosestPoint(Point=cp.Points, Cloud=gv_5)  # -> ClosestPoint, simplify(CPIndex), Distance
ugraphtodigraph = PythonScript(UG=G_4, edges=cp_2.CPIndex)  # -> out, DGV, IDGV; inputs UG: tree of Int32, edges: tree of Int32
# ---------- ugraphtodigraph: Python ----------
import Rhino.Geometry as rg
import rhinoscriptsyntax as rs
from Grasshopper.Kernel.Data import GH_Path
from Grasshopper import DataTree
import Grasshopper
import copy


def duplicateTree(tree):
    new_tree = DataTree[int]()
    for path in tree.Paths:
        branch = tree.Branch(path)
        new_tree.AddRange(branch, path)
    return new_tree

DGV = duplicateTree(UG)
IDGV = duplicateTree(UG)

for branch in edges.Branches:
    start, end = list(branch)
    DGV.Branch(end).Remove(start) #using method from C#
    IDGV.Branch(start).Remove(end)
# ---------- end ugraphtodigraph ----------

# ----
dgv = ClusterOutput(ugraphtodigraph.DGV)
idgv = ClusterOutput(ugraphtodigraph.IDGV)

# ==== cluster OOPStateActionGraph
gv_i_shapes_i = ClusterInput()
dg = ClusterInput()
idg = ClusterInput()
gv = ClusterInput()

# ---- group: translate graph i to shapes i
# these Clean components are a workaround. The cluster in GH eliminates empty branches. So I added Nulls to these branches outside of the cluster and now I have to clean them.
# use shapes index system as the standard for ordering the state space
gv_i_shapes_i_2 = Integer(gv_i_shapes_i)
idg_2 = Number(idg)
dg_2 = Number(dg)
gv_2 = Point(gv)
clean = CleanTree(RemoveNulls=True, RemoveInvalid=True, RemoveEmpty=False, Tree=dg_2)
clean_2 = CleanTree(RemoveNulls=True, RemoveInvalid=True, RemoveEmpty=False, Tree=idg_2)
python = PythonScript(DG=clean, IDG=clean_2, GV=gv_2, gv_to_shape=gv_i_shapes_i_2)  # -> out, DShapes, IDShapes, VShapes; inputs DG: tree of Int32, IDG: tree of Int32, GV: list of Point3d, gv_to_shape: list
# ---------- python: Python ----------
import Rhino.Geometry as rg
import rhinoscriptsyntax as rs
from Grasshopper.Kernel.Data import GH_Path
from Grasshopper import DataTree
import Grasshopper


def mapObjectList(l, map):
    new_l = [None for i in range(len(l))]
    for i in range(len(l)):
        new_l[map[i]] = l[i]
    return new_l
    
def mapIndexList(l, map):
    new_l = [None for i in range(len(l))]
    for i in range(len(l)):
        new_l[i] = map[l[i]]
    return new_l
        

#1) initialize datatrees to store graph with shapes indices 
DShapes = DataTree[object]() #DG with shapes indices
IDShapes = DataTree[object]() #IDG with shapes indices
VShapes = mapObjectList(GV, gv_to_shape) #G with shapes indices

for path in DG.Paths:
    i = int(GH_Path.ToString(path, False))
    print(i)
    dshapes_branch = mapIndexList(list(DG.Branch(path)), gv_to_shape)
    idshapes_branch = mapIndexList(list(IDG.Branch(path)), gv_to_shape)
    DShapes.AddRange(dshapes_branch, GH_Path(gv_to_shape[i]))
    print(i, GH_Path(gv_to_shape[i])[0], idshapes_branch, IDShapes.BranchCount)
    print(IDShapes.BranchCount, idshapes_branch, GH_Path(gv_to_shape[i]))
    IDShapes.AddRange(idshapes_branch, GH_Path(gv_to_shape[i]))
    print(IDShapes.BranchCount, idshapes_branch, GH_Path(gv_to_shape[i]))
    print
# ---------- end python ----------

# ----
groups = ClusterInput()
start_node = ClusterInput()
groups_2 = Integer(groups)
cir = Circle(Plane=python.VShapes, Radius=300)
points = PointList(Points=python.VShapes, Size=200)

# ---- group: initial_shapes
# additional work for multiple initial shapes
start_node_2 = Point(start_node)
gv_3 = Point(python.VShapes)
cp = ClosestPoint(Point=start_node_2, Cloud=gv_3)  # -> ClosestPoint, CPIndex, Distance
groups_3 = Integer(groups_2)
panel = Panel(cp.CPIndex)

# ----
start_node_i = Integer(cp.CPIndex)

# ---- group: initial_shapes (continued)
mindex = MemberIndex(Set=groups_3, Member=start_node_i)  # -> simplify(Index), Count
prune = PruneTree(Tree=mindex.Index, Minimum=1, Maximum=0)
viewer = ParamViewer(prune)
branch = TreeBranch(Tree=groups_3, Path=viewer, MaintainPaths=True)
flatten = FlattenTree(Tree=branch, Path="{0}")
panel_2 = Panel(flatten)

# ---- group: generate node objects
idgv = Integer(python.IDShapes)
dgv = Integer(python.DShapes)
root_i = Integer(flatten)
groups_4 = Integer(groups_2)
generatenodes = PythonScript(DGV=dgv, IDGV=idgv, groups=groups_4, root_i=root_i)  # -> out, nodes, root; inputs DGV: tree of Int32, IDGV: tree of Int32, groups: tree, root_i: list of Int32
# ---------- generatenodes: Python ----------
import Rhino.Geometry as rg
import rhinoscriptsyntax as rs
from Grasshopper.Kernel.Data import GH_Path
from Grasshopper import DataTree
import Grasshopper
import copy

class Node:
    """Class that will store the nodes for the customization"""
    def __init__(self, id, parents, children, neighbors):
        self.id = id
        self.parents = parents
        self.children = children
        self.neighbors = neighbors #includes itself
    
    def __str__(self):
        s = """
            Node {}
            Children = {}
            Parents = {}
            Neighbors = {}
            """.format(self.id, 
                       str(self.children), 
                       str(self.parents), 
                       str(self.neighbors))
        return s

def list2dToTree(l, type):
    """convert a 2d list to a data tree"""
    t = DataTree[type]()
    for i in range(len(l)):
        t.AddRange(l[i], GH_Path(i))
    return t

def createDictGroup(groups):
    """create a dictionary mapping each index to its group"""
    dict_group = {}
    for branch in groups.Branches:
        neighbor = sorted(list(branch))
        for i in branch:
            dict_group[i] = neighbor
    return dict_group

def separateChildrenByGroup(children, dict_group):
    grouped_children = []
    for child in children:
        if dict_group[child] not in grouped_children: 
            grouped_children.append(dict_group[child])
    return grouped_children
        

def generateNodesByBFS(DGV, IDGV, dict_group, root_i):
    """traverse the tree by BFS and builds the nodes for customization"""
    nodes = [None for i in range(DGV.BranchCount)]
    queue = root_i
    while len(queue) > 0:
        cur = queue.pop(0)
        print(cur)
        neighbors = dict_group[cur]
        parents = list(IDGV.Branch(cur))
        children = list(DGV.Branch(cur))
        grouped_children = separateChildrenByGroup(children, dict_group)
#        tree_children = list2dToTree(grouped_children, int)
        queue.extend(children)
        nodes[cur] = Node(cur, parents, grouped_children, neighbors)
    return nodes

#MAIN
root = None
dict_group = createDictGroup(groups)
nodes = generateNodesByBFS(DGV, IDGV, dict_group, root_i)
print(nodes)
# ---------- end generatenodes ----------
nodes = Data(generatenodes.nodes)

# ----
root_i_2 = ClusterOutput(root_i)
nodes_2 = ClusterOutput(nodes)
start_node_i_2 = ClusterOutput(start_node_i)
panel_3 = Panel(dgv)

# ==== cluster DisplayLayouts
perimeter_bound_rects = ClusterInput()

# ---- group: dimensions of boundary
perimeter_bound_rects_2 = Curve(perimeter_bound_rects)
item = ListItem(List=perimeter_bound_rects_2, Index=0, Wrap=True)
cp = ControlPoints(Curve=item)  # -> Points, Weights, Knots
pdecon = Deconstruct(Point=cp.Points)  # -> XComponent, YComponent, ZComponent
sort = SortList(Keys=pdecon.YComponent)  # -> Keys, ValuesA
sort_2 = SortList(Keys=pdecon.XComponent)  # -> Keys, ValuesA
item_2 = ListItem(List=sort_2.Keys, Index=0, Wrap=True)  # -> Item1, Item
item_3 = ListItem(List=sort.Keys, Index=0, Wrap=True)  # -> Item1, Item
subtraction = Subtraction(A=item_3.Item1, B=item_3.Item)
subtraction_2 = Subtraction(A=item_2.Item1, B=item_2.Item)

# ----
nodes = ClusterInput()
root_i = ClusterInput()

root_i_2 = Integer(root_i)
nodes_2 = Data(nodes)
countlayouts = PythonScript(nodes=nodes_2, root_i=root_i_2)  # -> out, a; inputs nodes: list, root_i: list
# ---------- countlayouts: Python ----------
from Grasshopper.Kernel.Data import GH_Path
from Grasshopper import DataTree
import copy

def recListToTree(T, l, path):
    """
    wrapper for recursive function that converts
    a multidimensional list to a data tree
    """
    #base case 1: creates branches for lists
    if type(l) != list and type(l) != tuple:
        path = path[:-1]
        T.Add(l, GH_Path(tuple(path)))
    #base case 2: creates empty branch for empty list
    elif l == []:
        T.EnsurePath(GH_Path(tuple(path)))
    #recursive case
    else:
        for i in range(len(l)):
            recListToTree(T, l[i], path + [i])

def listToTree(l, content = int):
    """
    wrapper for recursive function that converts
    a multidimensional list to a data tree
    """
    T = DataTree[content]()
    path = [0]
    recListToTree(T, l, path)
    T.SimplifyPaths()
    return T

class Node:
    """Class that will store the nodes for the customization"""
    def __init__(self, i, parents, children, neighbors):
        self.id = i
        self.parents = parents
        self.children = children
        self.neighbors = neighbors #includes itself
    
    def __str__(self):
        s = """
            Node {}
            Children = {}
            Parents = {}
            Neighbors = {}
            """.format(self.id, 
                       str(self.children), 
                       str(self.parents), 
                       str(self.neighbors))
        return s

def activeParentsI(current, child_parents):
    indices = []
    for parent in child_parents:
        if parent not in current: 
            indices.append(-1)
        else: indices.append(current.index(parent))
    return indices


start = set(root_i)
queue = [start]
all_states_sets = [start]
all_states_lists = [root_i]
c = 0
while len(queue) > 0 and c < 10000:
    nxt = list(queue.pop())
    for i in range(len(nxt)): #for element in state
        for children in nodes[nxt[i]].children: #for rules in element
            copy_nxt = copy.deepcopy(nxt)
            set_nxt = None
            #1) division rule
            if len(children) > 1: 
                set_nxt = set(copy_nxt[:i] + children + copy_nxt[i+1:])
            #2) union rule
            elif len(children) == 1 and len(nodes[children[0]].parents) > 1: 
                parents_i = activeParentsI(copy_nxt, nodes[children[0]].parents)
                if -1 not in parents_i:
                    parents_i.sort(reverse = True) #to pop higher index first
                    copycopy_nxt = copy.deepcopy(copy_nxt)
                    for i in parents_i: copycopy_nxt.pop(i)
                    copycopy_nxt.append(children[0])
                    set_nxt = set(copycopy_nxt)
            if set_nxt and set_nxt not in all_states_sets:
                queue.append(set_nxt)
                all_states_sets.append(set_nxt)
                all_states_lists.append(list(set_nxt))
                #print(all_states)
    c = c + 1
print(len(all_states_sets), len(all_states_lists))
a = listToTree(all_states_lists, content = int)
# ---------- end countlayouts ----------

margins = ClusterInput()
columns = ClusterInput()
pt = ClusterInput()
all_shapes_at_origin = ClusterInput()

# ---- group: CREATE GRID
shapes_i_floorplansi = Integer(countlayouts.a)
width = Number(subtraction_2)
height = Number(subtraction)
margins_2 = Integer(margins)
columns_2 = Integer(columns)
viewer = ParamViewer(shapes_i_floorplansi)
lng = ListLength(List=viewer)
division = Division(A=lng, B=columns_2)
addition = Addition(A=width, B=margins_2)
addition_2 = Addition(A=height, B=margins_2)
round = Round(Number=division)  # -> Nearest, Floor, Ceiling
pt_2 = Point(pt)

# ----
neg = Negative(Value=addition_2)

# ---- group: CREATE GRID (continued)
recgrid = Rectangular(Plane=pt_2, SizeX=addition, SizeY=neg, ExtentX=columns_2, ExtentY=round.Ceiling)  # -> simplify(Cells), Points

# ---- group: POPULATE GRID
n_of_floorplans = Integer(lng)
flip = FlipMatrix(Data=recgrid.Cells)
_1 = Integer(1)
all_shapes_at_origin_2 = Curve(all_shapes_at_origin)
shapes_i_floorplans_i = Integer(countlayouts.a)
flatten = FlattenTree(Tree=flip, Path="{0}")
subtraction_3 = Subtraction(A=n_of_floorplans, B=_1)
subset = SubList(List=flatten, Domain=subtraction_3, Wrap=True)  # -> List, Index
cp_2 = ControlPoints(Curve=subset.List)  # -> simplify(Points), Weights, Knots
item_4 = ListItem(List=cp_2.Points, Index=3, Wrap=True)  # -> simplify(Item)
item_5 = ListItem(List=all_shapes_at_origin_2, Index=shapes_i_floorplans_i, Wrap=True)
move = Move(Geometry=item_5, Motion=item_4)  # -> Geometry, Transform

# ----
G = ClusterOutput(move.Geometry)
shapes_i_floorplans_i_2 = ClusterOutput(shapes_i_floorplans_i)

# ==== cluster MapPtCrv: creates the index maps between pts and curves containing those pts

# ---- group: input
points = ClusterInput()
boundaries = ClusterInput()
points_2 = Point(points)
boundaries_2 = Curve(boundaries)

# ---- group: find curves i in boundary paths
error_in_cm = Panel("5")
crv_cp = CurveClosestPoint(Point=points_2, Curve=graft(boundaries_2))  # -> Point, Parameter, Distance
smaller = SmallerThan(FirstNumber=crv_cp.Distance, SecondNumber=error_in_cm)  # -> SmallerThan, OrEqualTo
mindex = MemberIndex(Set=smaller.SmallerThan, Member=Toggle(True))  # -> simplify(Index), Count

# ----
panel = Panel("1")  # disabled
incurve = PointInCurve(Point=points_2, Curve=graft(boundaries_2))  # -> Relationship, Point; disabled
int = Integer(panel)  # disabled
mindex_2 = MemberIndex(Set=incurve.Relationship, Member=int)  # -> simplify(Index), Count; disabled

panel_2 = Panel("solve indices")
invert_many_to_one_map = PythonScript(points=points_2, map=mindex.Index)  # -> out, pam; inputs points: list, map: tree of Int32
# ---------- invert_many_to_one_map: Python ----------
import Rhino.Geometry as rg
import rhinoscriptsyntax as rs
from Grasshopper.Kernel.Data import GH_Path
from Grasshopper import DataTree
import Grasshopper
import copy

map.RemovePath(GH_Path(-1))

pam = [-1 for i in range(len(points))] 
for path in map.Paths:
    branch = map.Branch(path)
    if path[0] > 0:
        for glaze_i in branch: pam[glaze_i] = path[0]
# ---------- end invert_many_to_one_map ----------

int_2 = Integer("-1")
panel_3 = Panel("check non-detected glazing")
mindex_3 = MemberIndex(Set=invert_many_to_one_map.pam, Member=int_2)  # -> Index, Count

# ---- group: output
point_curve = Integer(invert_many_to_one_map.pam)
curve_point = Integer(mindex.Index)
has_lost_values = Boolean(mindex_3.Index)
type = Text("special component: one-to-many with overlapping")
point_curve_2 = ClusterOutput(point_curve)
curve_point_2 = ClusterOutput(curve_point)
type_2 = ClusterOutput(type)
has_lost_values_2 = ClusterOutput(has_lost_values)

# ==== cluster MapPtCrv_2: creates the index maps between pts and curves containing those pts

# ---- group: input
points = ClusterInput()
boundaries = ClusterInput()
boundaries_2 = Curve(boundaries)
points_2 = Point(points)

# ----
panel = Panel("generate pt:curve")
incurves = PointInCurves(Point=points_2, Curves=boundaries_2)  # -> Relationship, Index, Point

# ---- group: test type
cset = CreateSet(List=incurves.Index)  # -> Set, Map
lng = ListLength(List=points_2)
lng_2 = ListLength(List=cset.Set)
equals = Equality(FirstNumber=lng_2, SecondNumber=lng)  # -> Equality, Inequality

# ---- group: inverting map
gate = StreamGate(Stream=incurves.Index, Gate=equals.Inequality)  # -> Target0, Target1
invert_many_to_one_map = PythonScript(boundaries=boundaries_2, map=gate.Target1)  # -> out, pam; inputs boundaries: list, map: list of Int32
# ---------- invert_many_to_one_map: Python ----------
import Rhino.Geometry as rg
import rhinoscriptsyntax as rs
from Grasshopper.Kernel.Data import GH_Path
from Grasshopper import DataTree
import Grasshopper
import copy

pam = DataTree[int]()
for i in range(len(boundaries)):
    pam.EnsurePath(i)
for i in range(len(map)):
    value = map[i]
    pam.Add(i, GH_Path(value))
# ---------- end invert_many_to_one_map ----------
invert_one_to_one_map = PythonScript(map=gate.Target0)  # -> out, pam; inputs map: list of Int32
# ---------- invert_one_to_one_map: Python ----------
pam = [-1 for i in range(len(map))] 
for i in range(len(map)):
    print(i)
    value = map[i]
    pam[value] = i
# ---------- end invert_one_to_one_map ----------
filter = StreamFilter(Gate=equals.Inequality, Stream0=invert_one_to_one_map.pam, Stream1=invert_many_to_one_map.pam)

# ----
panel_2 = Panel("check non-detected glazing")
index = ItemIndex(List=incurves.Index, Item="-1")
panel_3 = Panel(index)
equals_2 = Equality(FirstNumber=panel_3, SecondNumber="-1")  # -> Equality, Inequality

# ---- group: states
panel_4 = Panel("""one-to-one
one-to-many""")
item = ListItem(List=panel_4, Index=equals.Inequality, Wrap=True)

# ---- group: output
point_curve = Integer(incurves.Index)
curve_point = Integer(filter)
has_lost_values = Boolean(equals_2.Inequality)
type = Text(item)
point_curve_2 = ClusterOutput(point_curve)
curve_point_2 = ClusterOutput(curve_point)
type_2 = ClusterOutput(type)
has_lost_values_2 = ClusterOutput(has_lost_values)
